# Grasshopper definition GC_M1_ATSUSHI IMAI.gh (Grasshopper 1.0.7)
# plug-ins: ShapeDiverForGrasshopper

altura_del_domo = Slider(5.5, range=0..10)
eje_transversal = Slider(21, range=15..30)
ancho_de_lama = Slider(0.6, range=0..1)
número_de_lamas = Slider(24, range=0..100)
eje_longitudinal = Slider(28, range=20..35)
peralte_lama = Slider(0.05, range=0..0.1)
division = Division(A=eje_transversal, B=2)
x_coordinate = XCoordinate(eje_longitudinal)
y_coordinate = YCoordinate(division)
division_2 = Division(A=x_coordinate, B=2)
sddp = ShapeDiverDocumentPayload({AbsoluteTolerance=0, AngleTolerance=0, DistanceDisplayPrecision=0, GltfVersion="Gltf2", InputGroups="{}", OutputGroups="{}", RelativeTolerance=0, UnitSystem=0, VersionCreated="1.13.1.0", VersionSaved="1.13.1.0"})
negative = Negative(Value=y_coordinate)
construct_point = ConstructPoint(XCoordinate=division_2, YCoordinate=negative, ZCoordinate=0)
construct_point_2 = ConstructPoint(XCoordinate=division_2, YCoordinate=0, ZCoordinate=altura_del_domo)
construct_point_3 = ConstructPoint(XCoordinate=x_coordinate, YCoordinate=0, ZCoordinate=0)
construct_point_4 = ConstructPoint(XCoordinate=division_2, YCoordinate=0, ZCoordinate=altura_del_domo)
construct_point_5 = ConstructPoint(XCoordinate=division_2, YCoordinate=y_coordinate, ZCoordinate=0)
construct_point_6 = ConstructPoint(XCoordinate=0, YCoordinate=0, ZCoordinate=0)
domain_start = DomainStart(0.005)
arc_3pt = Arc3Pt(PointA=construct_point_6, PointB=construct_point_4, PointC=construct_point_3)  # -> Arc, Plane, Radius
arc_3pt_2 = Arc3Pt(PointA=construct_point_5, PointB=construct_point_2, PointC=construct_point)  # -> Arc, Plane, Radius
subtraction = Subtraction(A=1, B=domain_start)
range = Range(Domain=Domain(0, 1), Steps=número_de_lamas)
construct_domain = ConstructDomain(DomainStart=domain_start, DomainEnd=subtraction)
perp_frame = PerpFrame(Curve=reparameterize(arc_3pt.Arc), Parameter=0.5)
cull_index = CullIndex(List=reverse(range), Indices=0, Wrap=True)
sub_curve = SubCurve(BaseCurve=reparameterize(arc_3pt.Arc), Domain=construct_domain)
cull_index_2 = CullIndex(List=reverse(cull_index), Indices=0, Wrap=True)
perp_frame_2 = PerpFrame(Curve=reparameterize(sub_curve), Parameter=cull_index_2)
orient = Orient(Geometry=arc_3pt_2.Arc, Source=perp_frame, Target=perp_frame_2)  # -> Geometry, Transform
start = Start(0.5)
division_3 = Division(A=ancho_de_lama, B=2)
division_4 = Division(A=peralte_lama, B=2)
extend_curve = ExtendCurve(Curve=orient.Geometry, Type=1, Start=start, End=start)
negative_2 = Negative(Value=division_4)
negative_3 = Negative(Value=division_3)
construct_domain_2 = ConstructDomain(DomainStart=division_4, DomainEnd=negative_2)
construct_domain_3 = ConstructDomain(DomainStart=division_3, DomainEnd=negative_3)
perp_frames = PerpFrames(Curve=extend_curve, Count=10, Align=True)  # -> Frames, Parameters
rectangle = Rectangle(Plane=perp_frames.Frames, XSize=construct_domain_2, YSize=construct_domain_3, Radius=0)  # -> Rectangle, Length
Z = Z(20)
loft = Loft(
    Curves=rectangle.Rectangle,
    Options={Adjust=False, Closed=False, LoftEnds=0, LoftSimp=0, LoftType=0, Rebuild=10, Refit=0.01})
construct_point_7 = ConstructPoint(XCoordinate=0, YCoordinate=0, ZCoordinate=expr("x*-1", Z))
xy_plane = XYPlane(Origin=construct_point_7)
cap_holes = CapHoles(Brep=loft)
center_box = CenterBox(Base=xy_plane, X=100, Y=100, Z=Z)
solid_difference = SolidDifference(BrepsA=cap_holes, BrepsB=center_box)
legacy_material = LegacyMaterial(Color=ColourSwatch(SwatchColor=RGB(174, 33, 235)), FlatShading=False)
mesh_brep = MeshBrep(
    Brep=solid_difference,
    Settings={GridMaxCount=0, GridMinCount=16, JaggedSeams=False, MaxEdgeLength=0, MinEdgeLength=0.0001, MinTolerance=0, Refine=True, RefineAngle=0, RelativeTolerance=0.65, SimplePlanes=True, Tolerance=0})
legacy_display = LegacyDisplay(Geometry=mesh_brep, ShapeDiverMaterial=legacy_material)
