# Grasshopper definition GC_M2_KRESGE.gh (Grasshopper 1.0.7)
# plug-ins: ShapeDiverForGrasshopper

sddp = ShapeDiverDocumentPayload({AbsoluteTolerance=0, AngleTolerance=0, DistanceDisplayPrecision=0, GltfVersion="Gltf2", InputGroups="{}", OutputGroups="{}", RelativeTolerance=0, UnitSystem=0, VersionCreated="1.13.1.0", VersionSaved="1.13.1.0"})
radio_de_la_esfera = Slider(35, range=0..100)
xz_plane = XZPlane(Origin=Point(0, 0, 0))
rotate_plane = RotatePlane(Plane=xz_plane, Angle=degrees(-90))
sphere = Sphere(Base=rotate_plane, Radius=radio_de_la_esfera)
xz_plane_2 = XZPlane(Origin=Point(0, 0, 0))
xy_plane = XYPlane(Origin=Point(0, 0, 0))
yz_plane = YZPlane(Origin=Point(0, 0, 0))
brep_plane = BrepPlane(Brep=sphere, Plane=[xz_plane_2, xy_plane, yz_plane])  # -> Curves, Points
surface_split = SurfaceSplit(Surface=sphere, Curves=flatten(brep_plane.Curves))
list_item = ListItem(List=surface_split, Index=0, Wrap=True)
deconstruct_brep = DeconstructBrep(Brep=list_item)  # -> Faces, Edges, Vertices
construct_point = ConstructPoint(XCoordinate=0, YCoordinate=0, ZCoordinate=0)
polyline = PolyLine(Vertices=deconstruct_brep.Vertices, Closed=True)
polygon_center = PolygonCenter(Polyline=polyline)  # -> CenterV, CenterE, CenterA
vector_2pt = Vector2Pt(PointA=construct_point, PointB=polygon_center.CenterV, Unitize=False)  # -> Vector, Length
plane_normal = PlaneNormal(Origin=polygon_center.CenterV, ZAxis=vector_2pt.Vector)
xy_plane_2 = XYPlane(Origin=Point(0, 0, 0))
legacy_material = LegacyMaterial(Color=ColourSwatch(SwatchColor=RGB(48, 255, 172)), FlatShading=False)
legacy_material_2 = LegacyMaterial(Color=ColourSwatch(SwatchColor=RGB(197, 49, 255)), FlatShading=False)
orient = Orient(Geometry=list_item, Source=plane_normal, Target=xy_plane_2)  # -> Geometry, Transform
brep_edges = BrepEdges(Brep=orient.Geometry)  # -> Naked, Interior, NonManifold
project = Project(Geometry=brep_edges.Naked, Plane=PlaneXY(0, 0, 0))  # -> Geometry, Transform
edge_surface = EdgeSurface(CurveA=brep_edges.Naked, CurveB=project.Geometry)
legacy_display = LegacyDisplay(Geometry=edge_surface, ShapeDiverMaterial=legacy_material)
legacy_display_2 = LegacyDisplay(Geometry=orient.Geometry, ShapeDiverMaterial=legacy_material_2)
