# Grasshopper definition GC_M3_WATERLOO2.gh (Grasshopper 1.0.7)
# plug-ins: ShapeDiverForGrasshopper

n_armaduras_x_10 = Slider(4, range=2..8, expression="x*10")
sddp = ShapeDiverDocumentPayload({AbsoluteTolerance=0, AngleTolerance=0, DistanceDisplayPrecision=0, GltfVersion="Gltf2", InputGroups="{}", OutputGroups="{}", RelativeTolerance=0, UnitSystem=0, VersionCreated="1.13.1.0", VersionSaved="1.13.1.0"})
curve = Curve(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)
curve_2 = Curve(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)
divide_curve = DivideCurve(Curve=curve_2, Count=n_armaduras_x_10, Kinks=False)  # -> Points, Tangents, Parameters
curve_closest_point = CurveClosestPoint(Point=divide_curve.Points, Curve=curve)  # -> Point, Parameter, Distance
unit_z = UnitZ(Factor=1)
vector_2pt = Vector2Pt(PointA=curve_closest_point.Point, PointB=divide_curve.Points, Unitize=False)  # -> Vector, Length
cross_product = CrossProduct(VectorA=vector_2pt.Vector, VectorB=unit_z, Unitize=False)  # -> Vector, Length
pi = Pi(Factor=0.4)
pi_2 = Pi(Factor=1.75)
rotate = Rotate(Vector=vector_2pt.Vector, Axis=cross_product.Vector, Angle=pi_2)
rotate_2 = Rotate(Vector=vector_2pt.Vector, Axis=cross_product.Vector, Angle=pi)
biarc = BiArc(StartPoint=curve_closest_point.Point, StartTangent=rotate_2, EndPoint=divide_curve.Points, EndTangent=rotate, Ratio=0.45)  # -> FirstArc, SecondArc, BiArc
perp_frames = PerpFrames(Curve=biarc.SecondArc, Count=13, Align=True)  # -> Frames, Parameters
perp_frames_2 = PerpFrames(Curve=biarc.FirstArc, Count=6, Align=True)  # -> Frames, Parameters
align_plane = AlignPlane(Plane=perp_frames.Frames, Direction=graft(cross_product.Vector))  # -> Plane, Angle
align_plane_2 = AlignPlane(Plane=perp_frames_2.Frames, Direction=graft(cross_product.Vector))  # -> Plane, Angle
list_length = ListLength(List=align_plane.Plane)
list_length_2 = ListLength(List=align_plane_2.Plane)
rotate_plane = RotatePlane(Plane=align_plane.Plane, Angle=degrees(180))
rotate_plane_2 = RotatePlane(Plane=align_plane_2.Plane, Angle=degrees(180))
peralte_armaduras = Slider(3, range=1..6)
range = Range(Domain=Domain(0, 1), Steps=expr("x-1", list_length))
range_2 = Range(Domain=Domain(0, 1), Steps=expr("x-1", list_length_2))
construct_domain = ConstructDomain(DomainStart=0, DomainEnd=peralte_armaduras)
graph_mapper = GraphMapper(range, x0=0, x1=1, y0=0, y1=1, container_name="Bezier", cpx=[0, 0.2981126606, 0.664786458, 1], cpy=[0, 1, 1, 0])
graph_mapper_2 = GraphMapper(range_2, x0=0, x1=1, y0=0, y1=1, container_name="Bezier", cpx=[0, 0.2981126606, 0.664786458, 1], cpy=[0, 1, 1, 0])
remap_numbers = RemapNumbers(Value=graph_mapper, Source=Domain(0, 1), Target=construct_domain)  # -> Mapped, Clipped
remap_numbers_2 = RemapNumbers(Value=graph_mapper_2, Source=Domain(0, 1), Target=construct_domain)  # -> Mapped, Clipped
point_oriented = PointOriented(BasePlane=rotate_plane, UComponent=expr("x*-1", 0), VComponent=expr("x*-1", remap_numbers.Mapped), WComponent=0)
point_oriented_2 = PointOriented(BasePlane=rotate_plane, UComponent=remap_numbers.Mapped, VComponent=expr("x*-1", 0), WComponent=0)
point_oriented_3 = PointOriented(
    BasePlane=rotate_plane_2,
    UComponent=expr("x*-1", remap_numbers_2.Mapped),
    VComponent=remap_numbers_2.Mapped,
    WComponent=0)
point_oriented_4 = PointOriented(BasePlane=rotate_plane, UComponent=expr("x*-1", remap_numbers.Mapped), VComponent=expr("x*-1", 0), WComponent=0)
point_oriented_5 = PointOriented(BasePlane=rotate_plane_2, UComponent=remap_numbers_2.Mapped, VComponent=remap_numbers_2.Mapped, WComponent=0)
cull_index = CullIndex(List=rotate_plane_2, Indices=0, Wrap=True)
cull_index_2 = CullIndex(List=point_oriented_3, Indices=0, Wrap=True)
cull_index_3 = CullIndex(List=point_oriented_5, Indices=0, Wrap=True)
cull_index_4 = CullIndex(List=reverse(cull_index), Indices=0, Wrap=True)
cull_index_5 = CullIndex(List=reverse(cull_index_2), Indices=0, Wrap=True)
cull_index_6 = CullIndex(List=reverse(cull_index_3), Indices=0, Wrap=True)
cull_index_7 = CullIndex(List=point_oriented, Indices=0, Wrap=True)
cull_index_8 = CullIndex(List=point_oriented_4, Indices=0, Wrap=True)
cull_index_9 = CullIndex(List=point_oriented_2, Indices=0, Wrap=True)
merge = Merge(Data1=simplify(graft(cull_index_6)), Data2=simplify(graft(cull_index_5)), Data3=simplify(graft(cull_index_4)))
cull_index_10 = CullIndex(List=reverse(cull_index_7), Indices=0, Wrap=True)
cull_index_11 = CullIndex(List=reverse(cull_index_8), Indices=0, Wrap=True)
cull_index_12 = CullIndex(List=reverse(cull_index_9), Indices=0, Wrap=True)
merge_2 = Merge(Data1=simplify(graft(cull_index_12)), Data2=simplify(graft(cull_index_11)), Data3=simplify(graft(cull_index_10)))
polyline = PolyLine(Vertices=rotate_plane_2, Closed=False)
flatten_tree = FlattenTree(Tree=polyline, Path="{0}")
polyline_2 = PolyLine(Vertices=merge_2, Closed=True)
polyline_3 = PolyLine(Vertices=point_oriented_3, Closed=False)
polyline_4 = PolyLine(Vertices=point_oriented_5, Closed=False)
polyline_5 = PolyLine(Vertices=point_oriented_4, Closed=False)
polyline_6 = PolyLine(Vertices=point_oriented_2, Closed=False)
polyline_7 = PolyLine(Vertices=merge, Closed=True)
polyline_8 = PolyLine(Vertices=point_oriented, Closed=False)
shift_list = ShiftList(List=flatten_tree, Shift=1, Wrap=False)
explode = Explode(Curve=polyline_2, Recursive=True)  # -> Segments, Vertices
flatten_tree_2 = FlattenTree(Tree=polyline_6, Path="{0}")
flatten_tree_3 = FlattenTree(Tree=polyline_5, Path="{0}")
shortest_list = ShortestList(ListA=flatten_tree, ListB=shift_list, TrimMode=2)  # -> ListA, ListB
explode_2 = Explode(Curve=shortest_list.ListA, Recursive=True)  # -> graft(Segments), Vertices
explode_3 = Explode(Curve=shortest_list.ListB, Recursive=True)  # -> graft(Segments), Vertices
merge_3 = Merge(Data1=polyline_4, Data2=polyline_3, Data3=polyline_8)  # -> graft(Result)
shift_list_2 = ShiftList(List=flatten_tree_3, Shift=1, Wrap=False)
merge_4 = Merge(Data1=polyline, Data2=polyline_6, Data3=polyline_5)  # -> graft(Result)
perp_frames_3 = PerpFrames(Curve=explode.Segments, Count=1, Align=True)  # -> Frames, Parameters
explode_4 = Explode(Curve=polyline_7, Recursive=True)  # -> Segments, Vertices
explode_5 = Explode(Curve=merge_3, Recursive=True)  # -> Segments, Vertices
offset_curve = OffsetCurve(Distance=1, Corners=1)
shortest_list_2 = ShortestList(ListA=flatten_tree_2, ListB=shift_list_2, TrimMode=2)  # -> ListA, ListB
end_points = EndPoints(Curve=explode_3.Segments)  # -> Start, End
explode_6 = Explode(Curve=merge_4, Recursive=True)  # -> Segments, Vertices
end_points_2 = EndPoints(Curve=explode_2.Segments)  # -> Start, End
perp_frames_4 = PerpFrames(Curve=explode_4.Segments, Count=1, Align=True)  # -> Frames, Parameters
polygon = Polygon(Plane=perp_frames_3.Frames, Radius=0.05, Segments=4, FilletRadius=0)  # -> Polygon, Length
merge_5 = Merge(Data1=end_points_2.Start, Data2=end_points_2.End, Data3=end_points.End, Data4=end_points.Start)
perp_frames_5 = PerpFrames(Curve=explode_5.Segments, Count=1, Align=True)  # -> Frames, Parameters
graft_tree = GraftTree(Tree=shortest_list_2.ListB, IncludeEmptyLists=True, IncludeNullItems=True)
graft_tree_2 = GraftTree(Tree=shortest_list_2.ListA, IncludeEmptyLists=True, IncludeNullItems=True)
perp_frames_6 = PerpFrames(Curve=explode_6.Segments, Count=1, Align=True)  # -> Frames, Parameters
construct_mesh = ConstructMesh(Vertices=merge_5, Faces={A=0, B=1, C=2, D=3})
explode_7 = Explode(Curve=graft_tree, Recursive=True)  # -> Segments, Vertices
explode_8 = Explode(Curve=graft_tree_2, Recursive=True)  # -> Segments, Vertices
loft_mesh = LoftMesh(Polylines=polygon.Polygon, ComputeUV=False, IsometricUV=False, UVSize=1)
polygon_2 = Polygon(Plane=perp_frames_4.Frames, Radius=0.05, Segments=4, FilletRadius=0)  # -> Polygon, Length
polygon_3 = Polygon(Plane=perp_frames_5.Frames, Radius=0.05, Segments=4, FilletRadius=0)  # -> Polygon, Length
polygon_4 = Polygon(Plane=perp_frames_6.Frames, Radius=0.15, Segments=4, FilletRadius=0)  # -> Polygon, Length
end_points_3 = EndPoints(Curve=simplify(explode_7.Segments))  # -> graft(Start), graft(End)
end_points_4 = EndPoints(Curve=simplify(explode_8.Segments))  # -> graft(Start), graft(End)
loft_mesh_2 = LoftMesh(Polylines=polygon_2.Polygon, ComputeUV=False, IsometricUV=False, UVSize=1)
loft_mesh_3 = LoftMesh(Polylines=polygon_3.Polygon, ComputeUV=False, IsometricUV=False, UVSize=1)
merge_6 = Merge(Data1=end_points_4.Start, Data2=end_points_4.End, Data3=end_points_3.End, Data4=end_points_3.Start)
loft_mesh_4 = LoftMesh(Polylines=polygon_4.Polygon, ComputeUV=False, IsometricUV=False, UVSize=1)
legacy_material = LegacyMaterial(Color=ColourSwatch(SwatchColor=RGB(0, 17, 255)), FlatShading=False)
legacy_material_2 = LegacyMaterial(Color=ColourSwatch(SwatchColor=RGB(48, 145, 255)), Opacity=Slider(0.5, range=0..1), FlatShading=False)
legacy_material_3 = LegacyMaterial(Color=ColourSwatch(SwatchColor=RGB(161, 161, 161)), FlatShading=False)
construct_mesh_2 = ConstructMesh(Vertices=merge_6, Faces={A=0, B=1, C=2, D=3})
mostrar_estructura = BooleanToggle(True)
mostrar_piel = BooleanToggle(True)
stream_filter = StreamFilter(Gate=mostrar_piel, Stream1=flatten([construct_mesh, construct_mesh_2]))
stream_filter_2 = StreamFilter(Gate=mostrar_estructura, Stream1=flatten([loft_mesh_2, loft_mesh, loft_mesh_3]))
stream_filter_3 = StreamFilter(Gate=mostrar_estructura, Stream1=flatten(loft_mesh_4))
legacy_display = LegacyDisplay(Geometry=flatten(stream_filter_3), ShapeDiverMaterial=legacy_material)
legacy_display_2 = LegacyDisplay(Geometry=flatten(stream_filter_2), ShapeDiverMaterial=legacy_material_3)
legacy_display_3 = LegacyDisplay(Geometry=flatten(stream_filter), ShapeDiverMaterial=legacy_material_2)
