# Grasshopper definition GC_M4_GEODESICO.gh (Grasshopper 1.0.7)
# plug-ins: Weaverbird, ShapeDiverForGrasshopper

sddp = ShapeDiverDocumentPayload({AbsoluteTolerance=0, AngleTolerance=0, DistanceDisplayPrecision=0, GltfVersion="Gltf2", InputGroups="{}", OutputGroups="{}", RelativeTolerance=0, UnitSystem=0, VersionCreated="1.13.1.0", VersionSaved="1.13.1.0"})
base = Base(PlaneXY(0, 0, 0))

pcomp = PlaneComponents(Plane=base)  # -> Origin, XAxis, YAxis, ZAxis
num = Number(pcomp.XAxis)
pl = PlaneNormal(Origin=Point(0, 0, 0), ZAxis=graft([pcomp.XAxis, pcomp.YAxis, pcomp.ZAxis]))
neg = Negative(Value=num)
phi = GoldenRatio(Factor=[neg, num])
pt = PointXYZ(XComponent=[neg, num], YComponent=phi, ZComponent=0, System=pl, DataComparison="cross_reference")
prox = Proximity3D(Points=flatten(pt), Group=5)  # -> Links, Topology

vector_length = VectorLength(Vector=pcomp.ZAxis)
golden_ratio = GoldenRatio(Factor=vector_length)
radio_del_geodesico = Slider(35, range=0..100)
evaluate = Evaluate(Expression="sqrt(x^2+y^2)", x=golden_ratio, y=vector_length)
sphere = Sphere(Base=base, Radius=radio_del_geodesico)
division = Division(A=radio_del_geodesico, B=evaluate)
mesh_sphere_ex = MeshSphereEx(Base=PlaneXY(0, 0, 0), Radius=radio_del_geodesico, Count=50)
scale = Scale(Geometry=prox.Links, Center=Point(0, 0, 0), Factor=division)  # -> Geometry, Transform
frecuencia_de_subdivisión = Slider(7, range=1..7)
flatten_tree = FlattenTree(Tree=scale.Geometry, Path="{0}")
point_on_curve = PointOnCurve(flatten_tree, parameter=0.5)
cull_duplicates = CullDuplicates(Points=point_on_curve, Tolerance=0.1, CullMode=1)  # -> Points, Indices, Valence
list_item = ListItem(List=flatten_tree, Index=cull_duplicates.Indices, Wrap=True)
weaverbird_s_mesh_from_lines_weave_back = WeaverbirdsMeshFromLinesWeaveBack(Lines=list_item, MaximumValence=5)
weaverbird_s_split_triangles_subdivision = WeaverbirdsSplitTrianglesSubdivision(MeshCurves=weaverbird_s_mesh_from_lines_weave_back, Level=frecuencia_de_subdivisión)
deconstruct_mesh = DeconstructMesh(Mesh=weaverbird_s_split_triangles_subdivision)  # -> Vertices, Faces, Colours, Normals
surface_closest_point = SurfaceClosestPoint(Point=deconstruct_mesh.Vertices, Surface=sphere)  # -> Point, UVPoint, Distance
vector_2pt = Vector2Pt(PointA=base, PointB=surface_closest_point.Point, Unitize=False)  # -> Vector, Length
vector_length_2 = VectorLength(Vector=vector_2pt.Vector)
multiplication = Multiplication(A=vector_length_2, B=1000)
line_sdl = LineSDL(Start=surface_closest_point.Point, Direction=vector_2pt.Vector, Length=multiplication)
brep_curve = BrepCurve(Brep=sphere, Curve=line_sdl)  # -> Curves, flatten(Points)
value_list = ValueList({"Subdivisión del Icosaedro": 0, "Proyección a Esfera": 1}, selected="Subdivisión del Icosaedro")
construct_mesh = ConstructMesh(Vertices=brep_curve.Points, Faces=deconstruct_mesh.Faces)
stream_filter = StreamFilter(Gate=value_list, Stream0=weaverbird_s_split_triangles_subdivision, Stream1=construct_mesh)
mesh_edges = MeshEdges(Mesh=stream_filter)  # -> NakedEdges, InteriorEdges, NonManifoldEdges
perp_frames = PerpFrames(Curve=list_item, Count=1, Align=True)  # -> Frames, Parameters
perp_frames_2 = PerpFrames(Curve=mesh_edges.InteriorEdges, Count=1, Align=True)  # -> Frames, Parameters
polygon = Polygon(Plane=perp_frames.Frames, Radius=0.04, Segments=3, FilletRadius=0)  # -> Polygon, Length
polygon_2 = Polygon(Plane=perp_frames_2.Frames, Radius=0.05, Segments=3, FilletRadius=0)  # -> Polygon, Length
mostrar_esfera = BooleanToggle(False)
loft_mesh = LoftMesh(Polylines=polygon.Polygon, ComputeUV=False, IsometricUV=False, UVSize=1)  # -> flatten(Mesh)
legacy_material = LegacyMaterial(Color=ColourSwatch(SwatchColor=RGB(227, 34, 204)), FlatShading=False)
loft_mesh_2 = LoftMesh(Polylines=polygon_2.Polygon, ComputeUV=False, IsometricUV=False, UVSize=1)  # -> flatten(Mesh)
stream_filter_2 = StreamFilter(Gate=mostrar_esfera, Stream1=mesh_sphere_ex)
legacy_material_2 = LegacyMaterial(Color=ColourSwatch(SwatchColor=RGB(0, 0, 0)), FlatShading=False)
legacy_material_3 = LegacyMaterial(Color=ColourSwatch(SwatchColor=RGB(26, 237, 184)), Opacity=Slider(0.2, range=0..1), FlatShading=False)
legacy_display = LegacyDisplay(Geometry=flatten(loft_mesh_2), ShapeDiverMaterial=legacy_material)
legacy_display_2 = LegacyDisplay(Geometry=flatten(loft_mesh), ShapeDiverMaterial=legacy_material_2)
legacy_display_3 = LegacyDisplay(Geometry=flatten(stream_filter_2), ShapeDiverMaterial=legacy_material_3)
