# Grasshopper definition GC_M5_SISTEMA TENSEGRIDAD ELEMENTAL.gh (Grasshopper 1.0.7)
# plug-ins: ShapeDiverForGrasshopper, Kangaroo2 Components

sddb = ShapeDiverDatabase({AbsoluteTolerance=0, AngleTolerance=0, AppDescription="", AppName="unnamed", DocumentName="unnamed", InputGroups="{}", OutputGroups="{\"40c3c210-88d1-4913-88c2-a3ce302cf767\":{\"name\":\"ShapeDiver Output\",\"guid\":\"40c3c210-88d1-4913-88c2-a3ce302cf767\",\"index\":0,\"params\":[],\"indexFloor\":0,\"indexCeiling\":-1}}", RelativeTolerance=0, UnitSystem=0})
dimension_inicial = Slider(10, range=0..10)
construct_point = ConstructPoint(XCoordinate=0, YCoordinate=0, ZCoordinate=0)
unit_x = UnitX(Factor=1)
unit_z = UnitZ(Factor=1)
unit_y = UnitY(Factor=1)
length = Length(dimension_inicial)
line_sdl = LineSDL(Start=construct_point, Direction=unit_x, Length=length)
line_sdl_2 = LineSDL(Start=construct_point, Direction=unit_y, Length=length)
line_sdl_3 = LineSDL(Start=construct_point, Direction=unit_z, Length=length)
point_on_curve = PointOnCurve(line_sdl_2, parameter=0.5)
point_on_curve_2 = PointOnCurve(line_sdl, parameter=0.5)
point_on_curve_3 = PointOnCurve(line_sdl_3, parameter=0.5)
vector_2pt = Vector2Pt(PointA=point_on_curve_2, PointB=construct_point, Unitize=False)  # -> Vector, Length
vector_2pt_2 = Vector2Pt(PointA=point_on_curve, PointB=construct_point, Unitize=False)  # -> Vector, Length
vector_2pt_3 = Vector2Pt(PointA=point_on_curve_3, PointB=construct_point, Unitize=False)  # -> Vector, Length
move = Move(Geometry=line_sdl_2, Motion=vector_2pt_2.Vector)  # -> Geometry, Transform
move_2 = Move(Geometry=line_sdl, Motion=vector_2pt.Vector)  # -> Geometry, Transform
move_3 = Move(Geometry=line_sdl_3, Motion=vector_2pt_3.Vector)  # -> Geometry, Transform
multiplication = Multiplication(A=Slider(0.1, range=0..1), B=dimension_inicial)
# este factor viene de
# Motro, R., Tensegrity, structural systems for the future. London and Sterling, 2003
panel = Panel("1/1.468")
unit_z_2 = UnitZ(Factor=multiplication)
unit_x_2 = UnitX(Factor=multiplication)
unit_y_2 = UnitY(Factor=multiplication)
move_4 = Move(Geometry=move_2.Geometry, Motion=unit_z_2)  # -> Geometry, Transform
move_5 = Move(Geometry=move_3.Geometry, Motion=unit_y_2)  # -> Geometry, Transform
move_6 = Move(Geometry=move.Geometry, Motion=unit_x_2)  # -> Geometry, Transform
end_points = EndPoints(Curve=move_4.Geometry)  # -> Start, End
end_points_2 = EndPoints(Curve=move_5.Geometry)  # -> Start, End
end_points_3 = EndPoints(Curve=move_6.Geometry)  # -> Start, End
multiplication_2 = Multiplication(A=dimension_inicial, B=panel)
point = Point(end_points_3.End)
point_2 = Point(end_points.Start)
point_3 = Point(end_points_3.Start)
point_4 = Point(end_points_2.Start)
point_5 = Point(end_points.End)
point_6 = Point(end_points_2.End)
line = Line(StartPoint=point_6, EndPoint=point_5)
line_2 = Line(StartPoint=point_2, EndPoint=point_6)
line_3 = Line(StartPoint=point_3, EndPoint=point_5)
line_4 = Line(StartPoint=point_2, EndPoint=point_4)
line_5 = Line(StartPoint=point_2, EndPoint=point_3)
line_6 = Line(StartPoint=point_3, EndPoint=point_4)
line_7 = Line(StartPoint=point, EndPoint=point_4)
line_8 = Line(StartPoint=point_5, EndPoint=point)
line_9 = Line(StartPoint=point, EndPoint=point_6)
merge = Merge(
    Data1=line_2,
    Data2=line,
    Data3=line_5,
    Data4=line_3,
    Data5=line_4,
    Data6=line_9,
    Data7=line_7,
    Data8=line_8,
    Data9=line_6)
merge_2 = Merge(Data1=move_4.Geometry, Data2=move_6.Geometry, Data3=move_5.Geometry)
length_line = LengthLine(Line=merge, Length=multiplication_2, Strength=10)
length_line_2 = LengthLine(Line=merge_2, Length=dimension_inicial, Strength=10)
show = Show(G=merge)
show_2 = Show(G=merge_2)
iteraciones_simulacion = Slider(1000, range=1..1000)
entwine = Entwine(Branch00=length_line, Branch01=show, Branch02=show_2, Branch03=length_line_2, FlattenInputs=True)
zombiesolver = ZombieSolver(GoalObjects=entwine, Threshold=1e-10, Tolerance=0.0001, MaxIterations=iteraciones_simulacion)  # -> I, V, O
unflatten_tree = UnflattenTree(Tree=zombiesolver.O, Guide=entwine)
multiplication_3 = Multiplication(A=dimension_inicial, B=0.02)
explode_tree = ExplodeTree(Data=unflatten_tree)  # -> Branch0, Branch1, Branch2, Branch3, Branch4
multiplication_4 = Multiplication(A=multiplication_3, B=0.1)
pipe = Pipe(Curve=explode_tree.Branch1, Radius=multiplication_4, Caps=0)
pipe_2 = Pipe(Curve=explode_tree.Branch2, Radius=multiplication_3, Caps=0)
legacy_material = LegacyMaterial(Color=ColourSwatch(SwatchColor=RGB(26, 237, 184)), FlatShading=False)
legacy_material_2 = LegacyMaterial(Color=ColourSwatch(SwatchColor=RGB(227, 34, 204)), FlatShading=False)
mesh_surface = MeshSurface(Surface=pipe_2, UCount=1, VCount=10, Overhang=True, Equalize=False)
mesh_surface_2 = MeshSurface(Surface=pipe, UCount=1, VCount=10, Overhang=True, Equalize=False)
legacy_display = LegacyDisplay(Geometry=flatten(mesh_surface_2), ShapeDiverMaterial=legacy_material_2)
legacy_display_2 = LegacyDisplay(Geometry=flatten(mesh_surface), ShapeDiverMaterial=legacy_material)
